# Grasshopper definition Eto.Forms.Checkboxes.gh (Grasshopper 1.0.7)

panel = Panel("""Element 3
73534
43873""")
panel_2 = Panel("""Element 4
43453
73783""")
panel_3 = Panel("""Element 1
65165
65165""")
panel_4 = Panel("""Element 2
37537
43783""")
entwine = Entwine(Branch00=panel_3, Branch01=panel_4, Branch02=panel, Branch03=panel_2, FlattenInputs=True)
select_options = GhPythonScript(Options=entwine, selectOptions=Toggle(True))  # -> out, a; inputs Options: tree
# ---------- select_options: Python ----------
__author__ = "Administrator"
__version__ = "2024.05.23"

import Eto.Forms as forms
import Eto.Drawing as drawing
import ghpythonlib.components as ghcomp
from Grasshopper import DataTree
from Grasshopper.Kernel.Data import GH_Path
import Grasshopper

    
class ElementSelector(forms.Dialog[bool]):
    def __init__(self, elements):
        self.Title = "Select Elements"
        self.ClientSize = drawing.Size(200, 200)
        self.Padding = drawing.Padding(10)
        self.Resizable = False

        self.elements = elements
        self.checked_elements = []

        # Create a table layout
        layout = forms.TableLayout()
        layout.Spacing = drawing.Size(5, 5)
        layout.Rows.Add(forms.Label(Text="Select the elements:"))

        # Add checkboxes for each element
        self.checkboxes = []
        for element in elements:
            checkbox = forms.CheckBox(Text=str(element[0]))
            layout.Rows.Add(checkbox)
            self.checkboxes.append(checkbox)

        # Add OK and Cancel buttons
        buttons = forms.StackLayout(Orientation=forms.Orientation.Horizontal)
        ok_button = forms.Button(Text="OK")
        ok_button.Click += self.on_ok
        cancel_button = forms.Button(Text="Cancel")
        cancel_button.Click += self.on_cancel
        buttons.Items.Add(ok_button)
        buttons.Items.Add(cancel_button)
        
        layout.Rows.Add(None)  # Add a spacer
        layout.Rows.Add(buttons)

        self.Content = layout

    def on_ok(self, sender, e):
        self.checked_elements = [self.elements[i] for i, checkbox in enumerate(self.checkboxes) if checkbox.Checked]
        self.Close(True)

    def on_cancel(self, sender, e):
        self.Close(False)

def returnCheckedElements(elements):
    form = ElementSelector(elements)
    if form.ShowModal():
        return form.checked_elements
    else:
        return []

def tree_to_nested_list(data_tree):
    nested_list = []
    for path in data_tree.Paths:
        branch = data_tree.Branch(path)
        nested_list.append(list(branch))
    return nested_list
def nested_list_to_tree(nested_list):
    data_tree = DataTree[object]()
    for i, branch in enumerate(nested_list):
        path = GH_Path(i)
        data_tree.AddRange(branch, path)
    return data_tree

# Example list of elements to select from
elements = tree_to_nested_list(Options)
selected_elements=[]

# Create the dialog and get selected elements
if(selectOptions):
    selected_elements = returnCheckedElements(elements)

# Output the selected elements
a = nested_list_to_tree(selected_elements)
# ---------- end select_options ----------
panel_5 = Panel(select_options.a)
